% Simulink data dictionary IF.sldd

ia = Simulink.Signal(StorageClass="ExportedGlobal", DataType="single")
ic = Simulink.Signal(StorageClass="ExportedGlobal", DataType="single")
ib = Simulink.Signal(StorageClass="ExportedGlobal", DataType="single")
ialpha = Simulink.Signal(StorageClass="ExportedGlobal", DataType="single")
ibeta = Simulink.Signal(StorageClass="ExportedGlobal", DataType="single")
id = Simulink.Signal(StorageClass="ExportedGlobal", DataType="single")
iq = Simulink.Signal(StorageClass="ExportedGlobal", DataType="single")
Sig = Simulink.Signal()
CurrKi = Simulink.Parameter(35, DataType="single")
CurrKp = Simulink.Parameter(0.17, DataType="single")
ThetaOpen = Simulink.Signal(StorageClass="ExportedGlobal", DataType="single")
L = Simulink.Parameter(0.00179, StorageClass="Struct", StructName="motor", DataType="single")
Rs = Simulink.Parameter(1.93, StorageClass="Struct", StructName="motor", DataType="single")
flux = Simulink.Parameter(0.00779754234786, StorageClass="Struct", StructName="motor", DataType="single")
Pn = Simulink.Parameter(8, StorageClass="Struct", StructName="motor", DataType="single")
Udc = Simulink.Parameter(48, DataType="single")
Kt = Simulink.Parameter(0.132)