% Simulink data dictionary positionloop.sldd

Sig = Simulink.Signal()
speed_ref = 1750
Kt = 0.132
position_ref = Simulink.Parameter(3.141593)
Sig1 = Simulink.Signal()
Sig2 = Simulink.Signal()
Sig3 = Simulink.Signal()
Sig4 = Simulink.Signal()
Sig5 = Simulink.Signal()
Ts = Simulink.Parameter(0.0001)
J = Simulink.Parameter(9.6e-6)
CurrKp = Simulink.Parameter(0.17)
CurrKi = Simulink.Parameter(35)
L = Simulink.Parameter(0.00179, StorageClass="Struct", StructName="motor")
Rs = Simulink.Parameter(1.93, StorageClass="Struct", StructName="motor")
Ke = Simulink.Parameter(0.07639437)
SpdKp = Simulink.Parameter(0.3389, StorageClass="Struct", StructName="spd_kpki")
SpdKi = Simulink.Parameter(0.0144, StorageClass="Struct", StructName="spd_kpki")
flux = Simulink.Parameter(0.00779754234786, StorageClass="Struct", StructName="motor")
Udc = Simulink.Parameter(48)
Pn = Simulink.Parameter(8, StorageClass="Struct", StructName="motor")
ThetaOpen = Simulink.Signal(StorageClass="ExportedGlobal")
iq = Simulink.Signal(StorageClass="ExportedGlobal")
id = Simulink.Signal(StorageClass="ExportedGlobal")
ibeta = Simulink.Signal(StorageClass="ExportedGlobal")
ialpha = Simulink.Signal(StorageClass="ExportedGlobal")
ia = Simulink.Signal(StorageClass="ExportedGlobal", DataType="single")
ic = Simulink.Signal(StorageClass="ExportedGlobal", DataType="single")
ib = Simulink.Signal(StorageClass="ExportedGlobal", DataType="single")
PositionFd = Simulink.Signal(StorageClass="ExportedGlobal", DataType="single")